# Grasshopper definition Jewellery 2.gh (Grasshopper 1.0.7)

number_slider = Slider(200, range=0..1000)
construct_domain = ConstructDomain(DomainStart=Slider(0, range=0..100), DomainEnd=Slider(394, range=-1..460))
construct_domain_2 = ConstructDomain(DomainStart=Slider(1.527, range=0..2.001), DomainEnd=Slider(2.001, range=0..2.001))
construct_domain_3 = ConstructDomain(DomainStart=Slider(0, range=0..100), DomainEnd=Slider(23, range=-1..40))
xz_plane = XZPlane(Origin=Point(0, 0, 0))
range = Range(Domain=construct_domain_2, Steps=number_slider)
range_2 = Range(Domain=construct_domain, Steps=number_slider)
range_3 = Range(Domain=construct_domain_3, Steps=number_slider)
rotate_plane = RotatePlane(Plane=xz_plane, Angle=degrees(Slider(100, range=0..100)))
point_polar = PointPolar(BasePlane=rotate_plane, XYAngle=degrees(range_2), ZAngle=degrees(range_3), Offset=range)

number_slider_2 = Slider(1, range=0..1)
number_slider_3 = Slider(0.19, range=0..1)

interpolate = Interpolate(Vertices=point_polar, Degree=3, Periodic=False, KnotStyle=1)  # -> Curve, Length, Domain
construct_domain_4 = ConstructDomain(DomainStart=expr("-x/2", number_slider_3), DomainEnd=expr("x/2", number_slider_3))
construct_domain_5 = ConstructDomain(DomainStart=expr("-x/2", number_slider_2), DomainEnd=expr("x/2", number_slider_2))
perp_frame = PerpFrame(Curve=reparameterize(interpolate.Curve), Parameter=Slider(0, range=0..1))
rectangle = Rectangle(Plane=perp_frame, XSize=construct_domain_4, YSize=construct_domain_5, Radius=Slider(0.1, range=0..0.1))  # -> Rectangle, Length
sweep1 = Sweep1(Rail=interpolate.Curve, Sections=rectangle.Rectangle, Miter=1)
cap_holes = CapHoles(Brep=sweep1)
custom_preview = CustomPreview(Geometry=cap_holes, Material=ColourSwatch(SwatchColor=RGB(235, 216, 9)))
