# Grasshopper definition Rotate_rainbow.gh (Grasshopper 1.0.7)

floors = Slider(20, range=0..20)
rotation = Slider(6, range=0..30)
radius1 = GetNumber(Slider(15, range=0..50), AtLeast=1, AtMost=2147483647, Maximum=1.797693135e+308, Minimum=-1.797693135e+308)
radius2 = GetNumber(Slider(34, range=0..50), AtLeast=1, AtMost=2147483647, Maximum=1.797693135e+308, Minimum=-1.797693135e+308)
floors_2 = GetNumber(floors, AtLeast=1, AtMost=2147483647, Maximum=1.797693135e+308, Minimum=-1.797693135e+308)
rotation_2 = GetNumber(rotation, AtLeast=1, AtMost=2147483647, Maximum=1.797693135e+308, Minimum=-1.797693135e+308)
floor_to_floor = Slider(8, range=0..20)
pt = ConstructPoint(XCoordinate=0, YCoordinate=0, ZCoordinate=0)
ellipse = Ellipse(Plane=pt, Radius1=radius1, Radius2=radius2)  # -> Ellipse, Focus1, Focus2
series = Series(Start=0, Step=floor_to_floor, Count=floors_2)
series_2 = Series(Start=0, Step=rotation_2, Count=floors_2)
circle = Circle(Plane=pt, Radius=Slider(98, range=0..100))
Z = UnitZ(Factor=series)
rad = Radians(Degrees=series_2)
move = Move(Geometry=ellipse.Ellipse, Motion=Z)  # -> Geometry, Transform
boundary_surfaces = BoundarySurfaces(Edges=circle)
rotate = Rotate(Geometry=move.Geometry, Angle=rad, Plane=PlaneXY(0, 0, 0))  # -> Geometry, Transform

Z_2 = UnitZ(Factor=floor_to_floor)
extr = Extrude(Base=rotate.Geometry, Direction=Z_2)
cap = CapHoles(Brep=extr)

series_3 = Series(Start=0, Step=1, Count=floors_2)
mesh_brep = MeshBrep(
    Brep=[cap, boundary_surfaces],
    Settings={GridMaxCount=0, GridMinCount=16, JaggedSeams=False, MaxEdgeLength=0, MinEdgeLength=0.0001, MinTolerance=0, Refine=True, RefineAngle=0, RelativeTolerance=0.65, SimplePlanes=True, Tolerance=0})
gradient = Gradient(
    LowerLimit=0,
    UpperLimit=floors_2,
    Parameter=series_3,
    stops=[0: RGB(234, 38, 0), 0.25: RGB(234, 126, 0), 0.5: RGB(254, 244, 84), 0.75: RGB(173, 203, 249), 1: RGB(75, 107, 169)])
material = CreateMaterial(Diffuse=gradient, Specular=RGB(255, 255, 255), Emission=RGB(0, 0, 0), Transparency=0, Shine=0)
c_script = CSharpScript(objects=simplify(graft(mesh_brep)), materials=simplify(graft(material)))  # -> out, str; inputs objects: tree, materials: tree
# ---------- c_script: C# ----------
    if(objects.BranchCount != materials.BranchCount) return;

    var doc = new Rhino.FileIO.File3dm();

    //go through branches
    for(int i = 0; i < objects.BranchCount; i++)
    {
      var mat = materials.Branches[i][0] as Rhino.Display.DisplayMaterial;
      var objs = objects.Branches[i];

      var material = new Rhino.DocObjects.Material();
      material.DiffuseColor = mat.Diffuse;
      material.EmissionColor = mat.Emission;
      material.Transparency = mat.Transparency;
      material.Shine = mat.Shine;
      material.SpecularColor = mat.Specular;

      var atts = new Rhino.DocObjects.ObjectAttributes();
      atts.MaterialSource = Rhino.DocObjects.ObjectMaterialSource.MaterialFromObject;

      doc.AllMaterials.Add(material);
      atts.MaterialIndex = i;

      for(int j = 0; j < objs.Count; j++)
      {
        var obj = objs[j] as Rhino.Geometry.GeometryBase;
        Print(obj.ToString());

        switch(obj.ObjectType)
        {
          case Rhino.DocObjects.ObjectType.Curve:
            doc.Objects.AddCurve(obj as Curve, atts);
            break;
          case Rhino.DocObjects.ObjectType.Mesh:
            doc.Objects.AddMesh(obj as Mesh, atts);
            break;
        }
      }

    }

    var fwo = new Rhino.FileIO.File3dmWriteOptions();
    fwo.Version = 7;
    var arr = doc.ToByteArray(fwo);

    str = Convert.ToBase64String(arr);

    doc.Dispose();
# ---------- end c_script ----------

c_script_2 = CSharpScript()  # -> base64Draco; inputs mesh: Mesh
# ---------- c_script_2: C# ----------
    var options = new Rhino.FileIO.DracoCompressionOptions();
    options.CompressionLevel = 5;
    options.IncludeTextureCoordinates = false;
    options.IncludeVertexColors = false;

    var compressed = Rhino.FileIO.DracoCompression.Compress(mesh, options);
    base64Draco = compressed.ToBase64String();
# ---------- end c_script_2 ----------
preview = CustomPreview(Material=ColourSwatch(SwatchColor=RGB(255, 255, 255)))

preview_2 = CustomPreview(Geometry=mesh_brep, Material=material)

# ---- group: RH_OUT:Mesh
txt = Text(c_script_2)

# ---- group: RH_OUT:rainbow_rotate
txt_2 = Text(c_script.str)
