# Grasshopper definition box.gh (Grasshopper 1.0.7)

# ---- group: Height
number_slider = Slider(10, range=0..10)

# ----
mesh_box = MeshBox(Base={Plane=PlaneXY(0, 0, 0), X=Domain(-10, 10), Y=Domain(-10, 10), Z=Domain(-10, 10)}, XCount=10, YCount=10, ZCount=10)
unit_z = UnitZ(Factor=number_slider)
multiplication = Multiplication(A=unit_z, B=Slider(5, range=0..10))
move = Move(Geometry=mesh_box, Motion=multiplication)  # -> Geometry, Transform

# ---- group: RH_OUT:mesh
mesh = Mesh(move.Geometry)
