# Grasshopper definition colour.gh (Grasshopper 1.0.7)

floors = Slider(20, range=1..20)
rotation = Slider(6, range=1..30)
radius = GetNumber(Slider(34, range=1..50), AtLeast=1, AtMost=2147483647, Maximum=1.797693135e+308, Minimum=-1.797693135e+308)
floors_2 = GetNumber(floors, AtLeast=1, AtMost=2147483647, Maximum=1.797693135e+308, Minimum=-1.797693135e+308)
rotation_2 = GetNumber(rotation, AtLeast=1, AtMost=2147483647, Maximum=1.797693135e+308, Minimum=-1.797693135e+308)
floor_to_floor = Slider(6, range=0..20)
pt = ConstructPoint(XCoordinate=0, YCoordinate=0, ZCoordinate=0)
ellipse = Ellipse(Plane=pt, Radius1=Slider(15, range=0..50), Radius2=radius)  # -> Ellipse, Focus1, Focus2
series = Series(Start=0, Step=floor_to_floor, Count=floors_2)
series_2 = Series(Start=0, Step=rotation_2, Count=floors_2)
circle = Circle(Plane=pt, Radius=Slider(98, range=0..100))
Z = UnitZ(Factor=series)
rad = Radians(Degrees=series_2)
move = Move(Geometry=ellipse.Ellipse, Motion=Z)  # -> Geometry, Transform
rotate = Rotate(Geometry=move.Geometry, Angle=rad, Plane=PlaneXY(0, 0, 0))  # -> Geometry, Transform

Z_2 = UnitZ(Factor=floor_to_floor)
extr = Extrude(Base=rotate.Geometry, Direction=Z_2)
cap = CapHoles(Brep=extr)

boundary_surfaces = BoundarySurfaces(Edges=circle)
mesh_brep = MeshBrep(
    Brep=cap,
    Settings={GridMaxCount=0, GridMinCount=16, JaggedSeams=False, MaxEdgeLength=0, MinEdgeLength=0.0001, MinTolerance=0, Refine=True, RefineAngle=0, RelativeTolerance=0.65, SimplePlanes=True, Tolerance=0})
scale = Scale(Geometry=mesh_brep, Center=Point(0, 0, 0), Factor=0.5)  # -> Geometry, Transform
c_script = CSharpScript(mesh=scale.Geometry)  # -> base64Draco; inputs mesh: Mesh
# ---------- c_script: C# ----------
    var options = new Rhino.FileIO.DracoCompressionOptions();
    options.CompressionLevel = 5;
    options.IncludeTextureCoordinates = false;
    options.IncludeVertexColors = false;

    var compressed = Rhino.FileIO.DracoCompression.Compress(mesh, options);
    base64Draco = compressed.ToBase64String();
# ---------- end c_script ----------
mesh = Mesh([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])

# ---- group: RH_OUT:Mesh
txt = Text(c_script)

# ----
preview = CustomPreview(Geometry=scale.Geometry, Material=ColourSwatch(SwatchColor=RGB(255, 255, 255)))
