# Grasshopper definition graph.gh (Grasshopper 1.0.7)
# plug-ins: Pufferfish

# ---- group: CHANGE FROM HORIZONTAL TO VERTICAL
number_slider = Slider(450, range=0..1000)
deg = Degrees(Radians=number_slider)
X = UnitX(Factor=1)
prot = RotatePlane(Plane=X, Angle=degrees(number_slider))
mirror = Mirror(Geometry=prot, Plane=PlaneYZ(0, 0, 0))  # -> Geometry, Transform

# ----
point = Point([Point(25, 37, 0), Point(12, 28, 0), Point(18, 46, 0), Point(20, 16, 0), Point(8, 18, 0), Point(0, 27, 0), Point(18, 2, 0)])
points = GetPoint(point, AtLeast=1, AtMost=2147483647, Realtime=True)

height = GetNumber(Slider(4, range=1..30), AtLeast=1, AtMost=2147483647, Maximum=1.797693135e+308, Minimum=-1.797693135e+308)

# ---- group: Origin 01 / GRID
number_slider_2 = Slider(53, range=0..100)
number_slider_3 = Slider(60, range=0..100)
number_slider_4 = Slider(0.8, range=0..5)
recgrid = Rectangular(Plane=PlaneXY(0, 0, 0), SizeX=number_slider_4, SizeY=2, ExtentX=number_slider_3, ExtentY=number_slider_2)  # -> Cells, Points

sqgrid = Square(Plane=mirror.Geometry, Size=number_slider_4, ExtentX=number_slider_3, ExtentY=number_slider_2)  # -> flatten(Cells), Points

# ---- group: Origin 01 / COMBINE X AND Y
flip = FlipMatrix(Data=sqgrid.Points)  # -> simplify(Data)
merge = Merge(Data2=flip)

# ---- group: Origin 01 / SEPARETE POINTS IN AND OUT OF THE BOUNDARY
number_slider_5 = Slider(7, range=0..50)
pull = PullPoint(Point=flip, Geometry=points, ClosestOnly=True)  # -> ClosestPoint, Distance
larger = LargerThan(FirstNumber=pull.Distance, SecondNumber=number_slider_5)  # -> LargerThan, OrEqualTo
cull = CullPattern(List=flip, CullPattern=invert(larger.OrEqualTo))
cull_2 = CullPattern(List=flip, CullPattern=larger.OrEqualTo)

# ----
clean = CleanTree(RemoveNulls=True, RemoveInvalid=True, RemoveEmpty=False, Tree=flip)

# ---- group: Origin 01 / REPLACE POINTS IN THE RANGE WITH POINTS OVERLAPPING THE REPELLERS
cp = ClosestPoint(Point=cull, Cloud=flatten(cull_2))  # -> ClosestPoint, CPIndex, Distance
replace = ReplaceMembers(Set=clean, Find=cull, Replace=cp.ClosestPoint)

# ----
pline = PolyLine(Vertices=replace, Closed=False)

# ---- group: Origin 01
cir = Circle(Plane=pull.ClosestPoint, Radius=number_slider_5)
divide = DivideCurve(Curve=pline, Count=Slider(6.85, range=0..50), Kinks=False)  # -> Points, Tangents, Parameters
nurbs = NurbsCurve(Vertices=divide.Points, Degree=Slider(3, range=0..10), Periodic=False)  # -> Curve, Length, Domain

# ----
rebcrv = RebuildCurve(Curve=nurbs.Curve, Count=Slider(15, range=0..50), EndTangents=False)
crveditpts = CurveEditPoints(Curve=rebcrv, Knots=True)  # -> Points, Tangents, Parameters
cp_2 = ClosestPoint(Point=crveditpts.Points, Cloud=points)  # -> ClosestPoint, CPIndex, Distance
smaller = SmallerThan(FirstNumber=cp_2.Distance, SecondNumber=Slider(7.08, range=0..10))  # -> SmallerThan, OrEqualTo

cull_3 = CullPattern(List=crveditpts.Points, CullPattern=invert(smaller.OrEqualTo))
cull_4 = CullPattern(List=crveditpts.Points, CullPattern=smaller.OrEqualTo)

clean_2 = CleanTree(RemoveNulls=True, RemoveInvalid=True, RemoveEmpty=False, Tree=crveditpts.Points)
cp_3 = ClosestPoint(Point=cull_3, Cloud=flatten(cull_4))  # -> ClosestPoint, CPIndex, Distance
replace_2 = ReplaceMembers(Set=clean_2, Find=cull_3, Replace=cp_3.ClosestPoint)
lng = ListLength(List=replace_2)
range = Range(Domain=Domain(0, 1), Steps=expr("x-1", lng))
graph = GraphMapper(
    range,
    x0=0,
    x1=1,
    y0=0,
    y1=1,
    container_name="Sinc",
    Equation_X0=0.489697963,
    Equation_X1=0.6,
    Equation_Y0=0.6840355992,
    Equation_Y1=0.3)
dom = ConstructDomain(DomainStart=height, DomainEnd=Slider(11, range=1..20))
bnd = Bounds(Numbers=graph)
remap = RemapNumbers(Value=graph, Source=bnd, Target=dom)  # -> Mapped, Clipped
Z = UnitZ(Factor=remap.Mapped)
move = Move(Geometry=crveditpts.Points, Motion=Z)  # -> Geometry, Transform
intcrv = Interpolate(Vertices=move.Geometry, Degree=3, Periodic=False, KnotStyle=1)  # -> Curve, Length, Domain
explode = Explode(Curve=intcrv.Curve, Recursive=True)  # -> flatten(Segments), Vertices
join = JoinCurves(Curves=explode.Segments, Preserve=False)
midpt = CurveMiddle(Curve=join)
pdecon = Deconstruct(Point=midpt)  # -> XComponent, YComponent, ZComponent
bnd_2 = Bounds(Numbers=pdecon.ZComponent)
dedomain = DeconstructDomain(Domain=bnd_2)  # -> Start, End
gradient = Gradient(
    LowerLimit=0,
    UpperLimit=dedomain.End,
    Parameter=pdecon.ZComponent,
    stops=[0: RGB(186, 100, 237), 0: RGB(12, 242, 73), 0: RGB(247, 88, 127), 0: RGB(109, 182, 141), 0: RGB(0, 0, 0), 0: RGB(69, 6, 222), 0.226: RGB(126, 112, 91), 0.35: RGB(90, 92, 128), 0.406: RGB(116, 9, 95), 0.522: RGB(255, 0, 255)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])
c_script = CSharpScript(crv=join, color=gradient)  # -> out, A; inputs crv: Curve, color: Color
# ---------- c_script: C# ----------
    var c = color.R + "," + color.G + "," + color.B;
    crv.SetUserString("color", c);
    A = crv;
# ---------- end c_script ----------
preview = CustomPreview(Geometry=join, Material=gradient)

# ---- group: RH_OUT:crvs
crv = Curve(c_script.A)
